# Grasshopper definition gears.ghx (Grasshopper 0.9.76)
# plug-ins: Telepathy

pt = Point(<point referenced from the Rhino model>)
pt_2 = Point(<point referenced from the Rhino model>)
origins = Merge(Data1=pt_2, Data2=pt)
ln = Line(StartPoint=pt_2, EndPoint=pt)
dist = Distance(PointA=pt_2, PointB=pt)
origins_2 = RemoteSender(origins)
# # of teeth per millimeter of pitch diameter.
# 
# so P = NT / PD,
# and PD = NT / P.
multiplication = Multiplication(A=dist, B=2)
extra_rotation = Slider(110.94, range=0..400)
standard_pitches = Panel("""0.1
0.2
0.3
0.4
0.5
0.6
0.8
1.0
1.25
1.5
2.0
2.5
3
4
5
6
8
10
12
16
20
25
32
40
50""")
pressure_angle = Slider(20, range=14.5..20)

pt_3 = Point(<point referenced from the Rhino model>)
crv_cp = CurveClosestPoint(Point=pt_3, Curve=reparameterize(ln))  # -> Point, Parameter, Distance

error_weight = Slider(1, range=0..1)
pressure_angle_2 = RemoteSender(pressure_angle)
pressure_angle_3 = RemoteReceiver(pressure_angle_2)
cluster = Cluster_2(D=pressure_angle_3)
series = Series(Start=cluster, Step=1, Count=multiplication)
match = CSharpScript(target=dist, n_teeth=series, pitches=standard_pitches, factor=crv_cp.Parameter, e_weight=error_weight)  # -> out, Pitch, Teeth, Error; inputs n_teeth: list of Double, pitches: list of Double, factor: Double, e_weight: Double
# ---------- match: C# ----------
    var t = (double) target;

    double bestPitch = 0;
    var bestTeeth = new double[]{0,0};
    var bestdist = double.MaxValue;
    double bestdd = 0;

    foreach (var pitch in pitches) {
      for (var i = 0; i < n_teeth.Count; i++){
        var ri = (n_teeth[i] / pitch) / 2;
        for (var j = 0; j < n_teeth.Count; j++) {
          var rj = (n_teeth[j] / pitch) / 2;
          var dd = ri + rj - t;
          if (dd > 0) continue;

          var df = Math.Abs((ri / (ri + rj)) - factor) * t;
          var dist = (df * (1 - e_weight)) + (-dd * e_weight);

          if (dist < bestdist) {
            bestPitch = pitch;
            bestdist = dist;
            bestdd = dd;
            bestTeeth[0] = n_teeth[i];
            bestTeeth[1] = n_teeth[j];
          }
        }
      }
    }

    Pitch = bestPitch;
    Teeth = bestTeeth;
    Error = bestdd;
# ---------- end match ----------
of_teeth = RemoteSender(match.Teeth)
pitch = RemoteSender(match.Pitch)
current_pitch = Panel(match.Pitch)
pressure_angle_4 = RemoteReceiver(pressure_angle_2)
of_teeth_2 = RemoteReceiver(of_teeth)
pitch_2 = RemoteReceiver(pitch)
origins_3 = RemoteReceiver(origins_2)
of_teeth_3 = RemoteReceiver(of_teeth)
of_teeth_4 = RemoteReceiver(of_teeth)
pitch_3 = RemoteReceiver(pitch)
pi = Pi(Factor=2)
teeth = Teeth(pressure_angle=pressure_angle_4, pitch=pitch_2, center_point=origins_3, number_of_teeth=of_teeth_2)
division = Division(A=pi, B=of_teeth_4)
radii = Radii(of_teeth=of_teeth_3, pitch=pitch_3)  # -> R, R_2
of_teeth_5 = RemoteReceiver(of_teeth)
origins_4 = RemoteReceiver(origins_2)
origins_5 = RemoteReceiver(origins_2)
adjust_rot = AdjustRot(A=ln, P=origins_5, R=radii.R_2, A_2=division)
cluster_2 = Cluster(rotation_increment=division, tooth_curves=teeth, of_teeth=of_teeth_5, origins=origins_4)
initial_rot = InitialRot(A=extra_rotation, B=radii.R)
addition = Addition(A=adjust_rot, B=initial_rot)
origins_6 = RemoteReceiver(origins_2)
solidify = Solidify(radius=radii.R_2, origins=origins_6, rotation=addition)
origins_7 = RemoteReceiver(origins_2)
geo = Geometry(solidify)
rotate = Rotate(Geometry=cluster_2, Angle=graft(addition), Plane=graft(origins_7))  # -> Geometry, Transform

# ==== cluster Teeth
number_of_teeth = ClusterInput()
pitch = ClusterInput()
pitch_2 = Number(pitch)
number_of_teeth_2 = Integer(number_of_teeth)
pi = Pi(Factor=1)
division = Division(A=pitch_2, B=pi)
pi_2 = Pi(Factor=2)
division_2 = Division(A=number_of_teeth_2, B=pitch_2)
multiplication = Multiplication(A=division, B="1.25")
division_3 = Division(A=division_2, B=2)
division_4 = Division(A=pi_2, B=number_of_teeth_2)
neg = Negative(Value=multiplication)
pressure_angle = ClusterInput()
multiplication_2 = Multiplication(A=division_3, B=2)
center_point = ClusterInput()
pitch_diameter = Number(multiplication_2)
reference = Number(division_3)
pressure_angle_2 = Number(pressure_angle)
center_point_2 = Point(center_point)
alpha = Number(pressure_angle_2)
division_5 = Division(A=pitch_diameter, B=2)
addition = Addition(A=reference, B=division)
addition_2 = Addition(A=reference, B=neg)
rad = Radians(Degrees=alpha)
cir = Circle(Plane=center_point_2, Radius=reference)
outer = Number(addition)
inner = Number(addition_2)
cos = Cosine(Value=rad)
multiplication_3 = Multiplication(A=pitch_diameter, B=cos)
division_6 = Division(A=multiplication_3, B=2)
division_7 = Division(A=division_6, B=division_5)
acos = ArcCosine(Value=division_7)
division_8 = Division(A=division_6, B=inner)
min = Minimum(A=division_8, B="1.0")
pt = Point(center_point_2)
division_9 = Division(A=division_6, B=outer)
acos_2 = ArcCosine(Value=min)
acos_3 = ArcCosine(Value=division_9)
involute = Involute(R=reference, alpha=acos)
involute_2 = Involute(R=outer, alpha=acos_3)
involute_3 = Involute(R=inner, alpha=acos_2)
addition_3 = Addition(A=pt, B=involute_2)
addition_4 = Addition(A=pt, B=involute_3)
addition_5 = Addition(A=pt, B=involute)
division_10 = Division(A=division_4, B=2)
arc = Arc3Pt(PointA=addition_4, PointB=addition_5, PointC=addition_3)  # -> Arc, Plane, Radius
rotate = Rotate(Geometry=addition_5, Angle=division_10, Plane=pt)  # -> Geometry, Transform
pt_2 = Point(pt)
crv_cp = CurveClosestPoint(Point=addition_5, Curve=reparameterize(cir))  # -> Point, Parameter, Distance
pi_3 = Pi(Factor=2)
vec2pt = Vector2Pt(PointA=pt_2, PointB=rotate.Geometry, Unitize=False)  # -> Vector, Length
Z = UnitZ(Factor=1)
rotate_2 = Rotate(Geometry=arc.Arc, Angle=division_10, Plane=pt_2)  # -> Geometry, Transform
multiplication_4 = Multiplication(A=crv_cp.Parameter, B=pi_3)
pl = ConstructPlane(Origin=rotate.Geometry, XAxis=vec2pt.Vector, YAxis=Z)
mirror = Mirror(Geometry=rotate_2.Geometry, Plane=pl)  # -> graft(Geometry), Transform
division_11 = Division(A=division_10, B=2)
end = EndPoints(Curve=arc.Arc)  # -> Start, graft(End)
graft = GraftTree(Tree=arc.Arc, IncludeEmptyLists=True, IncludeNullItems=True)
end_2 = EndPoints(Curve=mirror.Geometry)  # -> Start, End
neg_2 = Negative(Value=division_11)
subtraction = Subtraction(A=neg_2, B=multiplication_4)
ln = Line(StartPoint=end.End, EndPoint=end_2.End)
join = JoinCurves(Curves=[graft, ln, mirror.Geometry], Preserve=False)  # -> simplify(Curves)
rotate_3 = Rotate(Geometry=join, Angle=graft(subtraction), Plane=graft(pt_2))  # -> Geometry, Transform
G = ClusterOutput(rotate_3.Geometry)

# ==== cluster InitialRot
A = ClusterInput()
B = ClusterInput()
pi = Pi(Factor=2)
division = Division(A=A, B=B)
division_2 = Division(A=division, B=pi)
item = ListItem(List=division_2, Index=0, Wrap=True)  # -> Item, Item1
neg = Negative(Value=item.Item1)
merge = Merge(Data1=item.Item, Data2=neg)
R = ClusterOutput(merge)

# ==== cluster AdjustRot
P = ClusterInput()
R = ClusterInput()
cir = Circle(Plane=P, Radius=R)
A = ClusterInput()
ccx = CurveCurve(CurveA=A, CurveB=reparameterize(cir))  # -> Points, ParamsA, ParamsB
pi = Pi(Factor=2)
A_2 = ClusterInput()
division = Division(A=A_2, B=2)
multiplication = Multiplication(A=pi, B=ccx.ParamsB)  # -> flatten(Result)
addition = Addition(A=multiplication, B=division)
item = ListItem(List=multiplication, Index=0, Wrap=True)  # -> Item, Item1
item_2 = ListItem(List=addition, Index=0, Wrap=True)  # -> Item, Item1
merge = Merge(Data1=item.Item, Data2=item_2.Item1)  # -> flatten(Result)
R_2 = ClusterOutput(merge)

# ==== cluster Cluster
tooth_curves = ClusterInput()
rotation_increment = ClusterInput()
of_teeth = ClusterInput()
origins = ClusterInput()
tooth_curves_2 = Curve(tooth_curves)
end = EndPoints(Curve=tooth_curves_2)  # -> Start, End
ln = Line(StartPoint=end.Start, EndPoint=end.End)
rotation_increment_2 = Number(rotation_increment)
of_teeth_2 = Number(of_teeth)
join = JoinCurves(Curves=[ln, tooth_curves_2], Preserve=False)
series = Series(Start=0, Step=rotation_increment_2, Count=of_teeth_2)
Z = UnitZ(Factor=1)
extr = Extrude(Base=join, Direction=Z)
cap = CapHoles(Brep=extr)
origins_2 = Point(origins)
rotate = Rotate(Geometry=cap, Angle=series, Plane=graft(origins_2))  # -> Geometry, Transform
G = ClusterOutput(rotate.Geometry)

# ==== cluster Solidify
rotation = ClusterInput()
radius = ClusterInput()
origins = ClusterInput()
radius_2 = Number(radius)
origins_2 = Point(origins)
cir = Circle(Plane=origins_2, Radius=radius_2)
sqrt = SquareRoot(Value=radius_2)
round = Round(Number=sqrt)  # -> Nearest, Floor, Ceiling
int = Integer(round.Floor)
polygon = Polygon(Plane=origins_2, Radius=int, Segments=6, FilletRadius=0)  # -> Polygon, Length
rotation_2 = Number(rotation)
rotate = Rotate(Geometry=graft(polygon.Polygon), Angle=graft(rotation_2), Plane=graft(origins_2))  # -> Geometry, Transform
graft = GraftTree(Tree=cir, IncludeEmptyLists=True, IncludeNullItems=True)  # -> simplify(Tree)
graft_2 = GraftTree(Tree=rotate.Geometry, IncludeEmptyLists=True, IncludeNullItems=True)  # -> simplify(Tree)
boundary = BoundarySurfaces(Edges=[graft, graft_2])
Z = UnitZ(Factor=1)
extr = Extrude(Base=boundary, Direction=Z)
E = ClusterOutput(extr)

# ==== cluster Cluster_2
D = ClusterInput()
rad = Radians(Degrees=D)
sin = Sine(Value=rad)
sin_2 = Sine(Value=rad)
multiplication = Multiplication(A=sin, B=sin_2)
division = Division(A="2", B=multiplication)
min_teeth = Integer(division)
min_teeth_2 = ClusterOutput(min_teeth)

# ==== cluster Radii
pitch = ClusterInput()
of_teeth = ClusterInput()
of_teeth_2 = Number(of_teeth)
pitch_2 = Number(pitch)
pi = Pi(Factor=1)
division = Division(A=of_teeth_2, B=pitch_2)
division_2 = Division(A=pitch_2, B=pi)
pitch_diameter = Number(division)
multiplication = Multiplication(A=division_2, B=1.25)
division_3 = Division(A=pitch_diameter, B=2)
R = ClusterOutput(division_3)
neg = Negative(Value=multiplication)
addition = Addition(A=division_3, B=neg)
R_2 = ClusterOutput(addition)

# ==== cluster Involute
R = ClusterInput()
alpha = ClusterInput()
R_2 = Number(R)
alpha_2 = Number(alpha)
tan = Tangent(Value=alpha_2)
subtraction = Subtraction(A=tan, B=alpha_2)
sin = Sine(Value=subtraction)
cos = Cosine(Value=subtraction)
multiplication = Multiplication(A=R_2, B=sin)
multiplication_2 = Multiplication(A=R_2, B=cos)
pt = ConstructPoint(XCoordinate=multiplication_2, YCoordinate=multiplication, ZCoordinate=0)
pt_2 = ClusterOutput(pt)
