# Grasshopper definition rug-pattern.ghx (Grasshopper 0.9.76)
# plug-ins: Pufferfish, Wombat

X = UnitX(Factor=1)
pt = Point(<point referenced from the Rhino model>)
number_slider = Slider(3, range=0..10)
addition = Addition(A=pt, B=X)
ln = Line(StartPoint=pt, EndPoint=addition)
neg = Negative(Value=Slider(2, range=0..10))
arrpolar = PolarArray(Geometry=ln, Plane=pt, Count=Slider(12, range=0..100), Angle=6.283185307)  # -> Geometry, Transform
pt_2 = Point(<point referenced from the Rhino model>)
pt_3 = Point(<point referenced from the Rhino model>)
polygon = Polygon(Plane=pt, Radius=number_slider, Segments=Slider(4, range=0..10), FilletRadius=0)  # -> Polygon, Length
number_slider_2 = Slider(4, range=0..10)
pt_4 = Point(<point referenced from the Rhino model>)
vec = VectorXYZ(XComponent=number_slider, YComponent=number_slider, ZComponent=0)  # -> Vector, Length
vec_2 = VectorXYZ(XComponent=0, YComponent=neg, ZComponent=0)  # -> Vector, Length
cir = Circle(Plane=pt, Radius=1)
Z = UnitZ(Factor=1)
addition_2 = Addition(A=number_slider, B=Slider(1, range=0..10))
pdecon = Deconstruct(Point=pt_2)  # -> XComponent, YComponent, ZComponent
pdecon_2 = Deconstruct(Point=pt_3)  # -> XComponent, YComponent, ZComponent
X_2 = UnitX(Factor=1)
X_3 = UnitX(Factor=number_slider)
pi = Pi(Factor=2)
vec_3 = VectorXYZ(XComponent=Slider(1, range=0..1), YComponent=Slider(0.4, range=0..1), ZComponent=0)  # -> Vector, Length
move = Move(Geometry=pt_4, Motion=vec_2.Vector)  # -> Geometry, Transform
addition_3 = Addition(A=pt, B=vec.Vector)
vec_4 = VectorXYZ(XComponent=Slider(1.8, range=0..10), YComponent=0, ZComponent=0)  # -> Vector, Length
addition_4 = Addition(A=pt, B=X_3)
Y = UnitY(Factor=addition_2)
arc = Arc(Plane=move.Geometry, Radius=1, Angle=Slider(0.62, range=0.1..1))  # -> Arc, Length
move_2 = Move(Geometry=pt_4, Motion=X_2)  # -> Geometry, Transform
pt_5 = ConstructPoint(XCoordinate=pdecon_2.XComponent, YCoordinate=pdecon.YComponent, ZCoordinate=0)
division = Division(A=pi, B=number_slider_2)
ln_2 = Line(StartPoint=pt, EndPoint=addition_3)
xy = XYPlane(Origin=addition_4)
addition_5 = Addition(A=pt, B=Y)
addition_6 = Addition(A=pt_4, B=vec_4.Vector)
end = EndPoints(Curve=arc.Arc)  # -> Start, End
pl = ConstructPlane(Origin=pt_4, XAxis=vec_3.Vector, YAxis=Z)
pi_2 = Pi(Factor=1)
mp = Midpoint(Curve=arc.Arc)

# ---- group: series-based construction
number_slider_3 = Slider(5, range=0..10)
panel = Panel("1")
neg_2 = Negative(Value=Slider(0.285, range=0..1))
series = Series(Start=panel, Step=Slider(0.203, range=0..1), Count=number_slider_3)
pt_6 = Point(move.Geometry)
series_2 = Series(Start=0, Step=neg_2, Count=number_slider_3)

# ----
Z_2 = UnitZ(Factor=1)
pt_7 = Point(pt)
series_3 = Series(Start=0, Step=division, Count=number_slider_2)
merge = Merge(Data1=pt_3, Data2=pt_5, Data3=pt_2)
vec2pt = Vector2Pt(PointA=end.Start, PointB=end.End, Unitize=False)  # -> Vector, Length
prot = RotatePlane(Plane=xy, Angle=pi_2)
polygon_2 = Polygon(Plane=addition_6, Radius=Slider(0.58, range=0..1), Segments=Slider(3, range=0..10), FilletRadius=0)  # -> Polygon, Length
cir_2 = Circle(Plane=move_2.Geometry, Radius=Slider(0.358, range=0..1))
xy_2 = XYPlane(Origin=mp)
polygon_3 = Polygon(Plane=addition_5, Radius=Slider(0.66, range=0..1), Segments=Slider(4, range=0..10), FilletRadius=0)  # -> Polygon, Length
rotate = Rotate(Geometry=pl, Angle=series_3, Plane=pt_4)  # -> Geometry, Transform
nurbs = NurbsCurve(Vertices=merge, Degree="2", Periodic=False)  # -> Curve, Length, Domain
pl_2 = ConstructPlane(Origin=end.Start, XAxis=vec2pt.Vector, YAxis=Z_2)
number_slider_4 = Slider(8, range=0..10)
polygon_4 = Polygon(Plane=prot, Radius=Slider(1, range=0..1), Segments=Slider(3, range=0..10), FilletRadius=0)  # -> Polygon, Length
mirror = Mirror(Geometry=cir_2, Plane=pl)  # -> Geometry, Transform
scale_nu = ScaleNU(Geometry=polygon_3.Polygon, Plane=addition_5, ScaleX=1, ScaleY=Slider(1.5, range=0..10), ScaleZ=1)  # -> Geometry, Transform
neg_3 = Negative(Value=Slider(1, range=0..1))
offcrv = OffsetCurve(
    Curve=nurbs.Curve,
    Distance=Slider(0.37, range=0..1),
    Plane=PlaneXY(0, 0, 0),
    BothSides=invert(False),
    Kinks=0,
    CapType=Slider(3, range=0..3))
mirror_2 = Mirror(Geometry=arc.Arc, Plane=pl_2)  # -> Geometry, Transform

# ---- group: domain-based construction
neg_4 = Negative(Value=Slider(1.07, range=0.5..1.5))
subtraction = Subtraction(A=Slider(3, range=0..10), B=1)
dom = ConstructDomain(DomainStart=0, DomainEnd=neg_4)
dom_2 = ConstructDomain(DomainStart=panel, DomainEnd=Slider(1.75, range=1.05..2))
range = Range(Domain=dom_2, Steps=subtraction)
range_2 = Range(Domain=dom, Steps=subtraction)
scale = Scale(Geometry=mirror_2.Geometry, Center=pt_6, Factor=range)  # -> Geometry, Transform
rotate_2 = Rotate(Geometry=scale.Geometry, Angle=range_2, Plane=pt_6)  # -> Geometry, Transform

# ----
merge_2 = Merge(Data1=mirror.Geometry, Data2=cir_2)
range_3 = Range(Domain=Domain(0, 1), Steps=Slider(100, range=0..1000))
pt_8 = Point(pt_4)
yz = YZPlane(Origin=pt_7)
xz = XZPlane(Origin=pt_7)
scale_nu_2 = ScaleNU(Geometry=polygon_2.Polygon, Plane=addition_6, ScaleX=1, ScaleY=Slider(2.6, range=0..10), ScaleZ=1)  # -> Geometry, Transform
scale_2 = Scale(Geometry=scale_nu_2.Geometry, Center=pt_8, Factor=neg_3)  # -> Geometry, Transform
eval = EvaluateCurve(Curve=reparameterize(offcrv), Parameter=range_3)  # -> Point, Tangent, Angle
scale_3 = Scale(Geometry=mirror_2.Geometry, Center=pt_6, Factor=series)  # -> Geometry, Transform
orient = Orient(Geometry=graft(merge_2), Source=pl, Target=rotate.Geometry)  # -> Geometry, Transform
rotate_3 = Rotate(Geometry=xy_2, Angle=series_2, Plane=pt_6)  # -> Geometry, Transform
mp_2 = Midpoint(Curve=scale_3.Geometry)
area = Area(Geometry=orient.Geometry)  # -> Area, Centroid
crv_cp = CurveClosestPoint(Point=eval.Point, Curve=reparameterize(nurbs.Curve))  # -> Point, Parameter, Distance
pi_3 = Pi(Factor=2)
pi_4 = Pi(Factor=2)
xy_3 = XYPlane(Origin=mp_2)
division_2 = Division(A=pi_3, B=number_slider_4)
subtraction_2 = Subtraction(A=number_slider_4, B="2")
orient_2 = Orient(Geometry=scale_3.Geometry, Source=xy_3, Target=rotate_3.Geometry)  # -> Geometry, Transform
division_3 = Division(A=pi_4, B=subtraction_2)

# ---- group: non-oriented rotate
rotate_4 = Rotate(Geometry=scale_3.Geometry, Angle=series_2, Plane=pt_6)  # -> Geometry, Transform

# ----
subtraction_3 = Subtraction(A=crv_cp.Parameter, B=Slider(0.5, range=0..1))
scale_4 = Scale(Geometry=orient.Geometry, Center=area.Centroid, Factor=Slider(0.56, range=0..1))  # -> Geometry, Transform
series_4 = Series(Start=0, Step=division_2, Count=number_slider_4)
series_5 = Series(Start=0, Step=division_3, Count=subtraction_2)
abs = Absolute(Value=subtraction_3)
geo = Geometry(orient_2.Geometry)
scale_5 = Scale(Geometry=scale_4.Geometry, Center=pt_4, Factor=Slider(0.84, range=0..1))  # -> Geometry, Transform
number_slider_5 = Slider(8, range=0..10)
multiplication = Multiplication(A=abs, B=1.999)
number_slider_6 = Slider(0.6, range=0..1)
subtraction_4 = Subtraction(A=Slider(1, range=0..1), B=multiplication)
vec_5 = VectorXYZ(XComponent=Slider(2.4, range=0..10), YComponent=Slider(1.9, range=0..10), ZComponent=0)  # -> Vector, Length
pt_9 = Point(addition_4)
scale_nu_3 = ScaleNU(Geometry=geo, Plane=pt_8, ScaleX=neg_3, ScaleY=1, ScaleZ=1)  # -> Geometry, Transform
pt_10 = Point(pt_4)
scale_nu_4 = ScaleNU(Geometry=geo, Plane=pt_8, ScaleX=1, ScaleY=neg_3, ScaleZ=1)  # -> Geometry, Transform
scale_6 = Scale(Geometry=geo, Center=pt_8, Factor=neg_3)  # -> Geometry, Transform
move_3 = Move(Geometry=pt_10, Motion=vec_5.Vector)  # -> Geometry, Transform
scale_7 = Scale(Geometry=eval.Point, Center=crv_cp.Point, Factor=subtraction_4)  # -> Geometry, Transform
division_4 = Division(A=number_slider_5, B=2)
X_4 = UnitX(Factor=Slider(2, range=0..10))
X_5 = UnitX(Factor=number_slider_6)
xz_2 = XZPlane(Origin=pt_9)
pline = PolyLine(Vertices=scale_7.Geometry, Closed=False)
merge_3 = Merge(Data1=flatten(ln_2), Data2=flatten(pline))
mirror_3 = Mirror(Geometry=merge_3, Plane=yz)  # -> Geometry, Transform
merge_4 = Merge(Data1=mirror_3.Geometry, Data2=merge_3)
mirror_4 = Mirror(Geometry=merge_4, Plane=xz)  # -> Geometry, Transform
rotate_5 = Rotate(Geometry=graft(merge_3), Angle=series_4, Plane=pt_7)  # -> Geometry, Transform
Y_2 = UnitY(Factor=number_slider_6)
polygon_5 = Polygon(Plane=move_3.Geometry, Radius=Slider(0.85, range=0..1), Segments=number_slider_5, FilletRadius=0)  # -> Polygon, Length
move_4 = Move(Geometry=pt_9, Motion=X_4)  # -> Geometry, Transform
repeat = RepeatData(Data="1", Length=division_4)
repeat_2 = RepeatData(Data="0", Length=division_4)
move_5 = Move(Geometry=move_4.Geometry, Motion=X_5)  # -> Geometry, Transform
move_6 = Move(Geometry=move_4.Geometry, Motion=Y_2)  # -> Geometry, Transform
merge_5 = Merge(Data1=repeat_2, Data2=repeat)
disc = Discontinuity(Curve=polygon_5.Polygon, Level=1)  # -> Points, Parameters
neg_5 = Negative(Value=Slider(1, range=0..1))
ln_3 = Line(StartPoint=move_6.Geometry, EndPoint=move_5.Geometry)
not = GateNot(A=merge_5)
cull = CullPattern(List=disc.Points, CullPattern=merge_5)
scale_nu_5 = ScaleNU(Geometry=ln_3, Plane=move_4.Geometry, ScaleX=1, ScaleY=neg_5, ScaleZ=1)  # -> Geometry, Transform
cull_2 = CullPattern(List=disc.Points, CullPattern=not)
neg_6 = Negative(Value=Slider(2.5, range=0..10))
number_slider_7 = Slider(3, range=0..10)
avr = Average(Input=cull)
join = JoinCurves(Curves=[scale_nu_5.Geometry, ln_3], Preserve=False)
merge_6 = Merge(Data1=cull_2, Data2=avr)
pi_5 = Pi(Factor=Slider(0.5, range=0..1))
scale_nu_6 = ScaleNU(Geometry=join, Plane=move_4.Geometry, ScaleX=neg_6, ScaleY=1, ScaleZ=1)  # -> Geometry, Transform
pi_6 = Pi(Factor=Slider(0.3, range=0..1))
division_5 = Division(A=pi_5, B=number_slider_7)
pline_2 = PolyLine(Vertices=merge_6, Closed=invert(False))
neg_7 = Negative(Value=Slider(0.11, range=0..1))
join_2 = JoinCurves(Curves=[scale_nu_6.Geometry, join], Preserve=False)
disc_2 = Discontinuity(Curve=join_2, Level=1)  # -> Points, Parameters
series_6 = Series(Start=0, Step=division_5, Count=number_slider_7)
cp = ClosestPoint(Point=pt_9, Cloud=disc_2.Points)  # -> ClosestPoint, CPIndex, Distance
series_7 = Series(Start=Slider(1, range=0..1), Step=neg_7, Count=number_slider_7)
rotate_6 = Rotate(Geometry=pline_2, Angle=pi_6, Plane=move_3.Geometry)  # -> Geometry, Transform
pi_7 = Pi(Factor=2)
disc_3 = Discontinuity(Curve=rotate_6.Geometry, Level=1)  # -> Points, Parameters
scale_8 = Scale(Geometry=join_2, Center=cp.ClosestPoint, Factor=series_7)  # -> Geometry, Transform
ln_4 = Line(StartPoint=move_3.Geometry, EndPoint=disc_3.Points)
range_4 = Range(Domain=pi_7, Steps=Slider(4, range=0..10))
rotate_7 = Rotate(Geometry=scale_8.Geometry, Angle=series_6, Plane=cp.ClosestPoint)  # -> Geometry, Transform
group = Group(Objects=flatten([ln_4, rotate_6.Geometry]))
cull_i = CullIndex(List=range_4, Indices="-1", Wrap=True)
mirror_5 = Mirror(Geometry=rotate_7.Geometry, Plane=xz_2)  # -> Geometry, Transform
pi_8 = Pi(Factor=1)
rotate_8 = Rotate(Geometry=group, Angle=cull_i, Plane=pt_10)  # -> Geometry, Transform
merge_7 = Merge(Data1=rotate_7.Geometry, Data2=mirror_5.Geometry)
ungroup = Ungroup(Group=rotate_8.Geometry)
multiplication_2 = Multiplication(A=Slider(1, range=0.5..2), B=pi_8)
lng = ListLength(List=rotate_8.Geometry)
group_2 = Group(Objects=merge_7)
rotate_9 = Rotate(Geometry=graft([polygon_4.Polygon, scale_nu.Geometry, group_2]), Angle=series_5, Plane=pt_7)  # -> Geometry, Transform
item = ListItem(List=ungroup, Index=0, Wrap=True)
series_8 = Series(Start=0, Step=multiplication_2, Count=lng)
pcen = PolygonCenter(Polyline=item)  # -> flatten(CenterV), CenterE, CenterA
rotate_10 = Rotate(Geometry=rotate_8.Geometry, Angle=series_8, Plane=pcen.CenterV)  # -> Geometry, Transform
pt_11 = Point(<point referenced from the Rhino model>)
yz_2 = YZPlane(Origin=pt_4)
group_3 = Group(Objects=flatten([rotate_5.Geometry, pline, rotate_9.Geometry, cir, arrpolar.Geometry, polygon.Polygon]))
group_4 = Group(Objects=flatten([scale_nu_2.Geometry, scale_2.Geometry, scale_6.Geometry, scale_nu_3.Geometry, scale_nu_4.Geometry, scale_5.Geometry, orient.Geometry, rotate_10.Geometry, orient_2.Geometry]))
pt_12 = Point(pt_4)
neg_8 = Negative(Value=Slider(1, range=0..1))
mirror_6 = Mirror(Geometry=group_3, Plane=yz_2)  # -> Geometry, Transform
scale_9 = Scale(Geometry=group_4, Center=pt_11, Factor=neg_8)  # -> Geometry, Transform
transform = Transform(Geometry=pt_12, Transform=scale_9.Transform)
Z_3 = UnitZ(Factor=1)
vec2pt_2 = Vector2Pt(PointA=pt_12, PointB=transform, Unitize=False)  # -> Vector, Length
pl_3 = ConstructPlane(Origin=pt_11, XAxis=vec2pt_2.Vector, YAxis=Z_3)
mirror_7 = Mirror(Geometry=group_3, Plane=pl_3)  # -> Geometry, Transform
