# Grasshopper definition screws.gh (Grasshopper 0.9.76)
# plug-ins: Telepathy

inner_thread_r = Slider(0.199, range=0..1)
thread_height = Slider(1.6, range=0..10)
numthreads = Slider(36, range=0..100)
head_height = Slider(0.25, range=0..1)
head_radius = Slider(0.5, range=0..1)
inner_thread_r_2 = RemoteSender(inner_thread_r)
thread_height_2 = RemoteSender(thread_height)
num_threads = RemoteSender(numthreads)
head_height_2 = RemoteSender(head_height)
head_r = RemoteSender(head_radius)
base_point_1 = Point(<point referenced from the Rhino model>)
base_point_2 = Point(<point referenced from the Rhino model>)
inner_thread_r_3 = RemoteReceiver(inner_thread_r_2)
thread_height_3 = RemoteReceiver(thread_height_2)
head_height_3 = RemoteReceiver(head_height_2)
thread_height_4 = RemoteReceiver(thread_height_2)
inner_thread_r_4 = RemoteReceiver(inner_thread_r_2)
head_r_2 = RemoteReceiver(head_r)
head_height_4 = RemoteReceiver(head_height_2)
base_point_1_2 = RemoteSender(base_point_1)
head_r_3 = RemoteReceiver(head_r)
base_point_2_2 = RemoteSender(base_point_2)

base_point_1_3 = RemoteReceiver(base_point_1_2)
Z = UnitZ(Factor=thread_height_4)
move = Move(Geometry=base_point_1_3, Motion=Z)  # -> Geometry, Transform
cir = Circle(Plane=base_point_1_3, Radius=inner_thread_r_4)
cyl = Cylinder(Base=base_point_1_3, Radius=inner_thread_r_4, Length=thread_height_4)
# Base - Shared
Z_2 = UnitZ(Factor=head_height_4)
cir_2 = Circle(Plane=move.Geometry, Radius=inner_thread_r_4)
move_2 = Move(Geometry=move.Geometry, Motion=Z_2)  # -> Geometry, Transform
cir_3 = Circle(Plane=move_2.Geometry, Radius=head_r_3)
loft = Loft(Curves=[cir_2, cir_3], Options={Adjust=False, Closed=False, LoftEnds=0, LoftSimp=0, LoftType=0, Rebuild=10, Refit=0.01})
pt = Point(move_2.Geometry)
srf = Surface([cir, cir_3])
join = BrepJoin(Breps=[cyl, loft, srf])  # -> Breps, Closed

base_point_2_3 = RemoteReceiver(base_point_2_2)
Z_3 = UnitZ(Factor=thread_height_3)
move_3 = Move(Geometry=base_point_2_3, Motion=Z_3)  # -> Geometry, Transform
cir_4 = Circle(Plane=base_point_2_3, Radius=inner_thread_r_3)
cyl_2 = Cylinder(Base=base_point_2_3, Radius=inner_thread_r_3, Length=thread_height_3)
Z_4 = UnitZ(Factor=head_height_3)
cir_5 = Circle(Plane=move_3.Geometry, Radius=inner_thread_r_3)
move_4 = Move(Geometry=move_3.Geometry, Motion=Z_4)  # -> Geometry, Transform
cir_6 = Circle(Plane=move_4.Geometry, Radius=head_r_2)
loft_2 = Loft(Curves=[cir_5, cir_6], Options={Adjust=False, Closed=False, LoftEnds=0, LoftSimp=0, LoftType=0, Rebuild=10, Refit=0.01})
srf_2 = Surface([cir_4, cir_6])
pt_2 = Point(move_4.Geometry)
join_2 = BrepJoin(Breps=[cyl_2, loft_2, srf_2])  # -> Breps, Closed

thread_height_5 = RemoteReceiver(thread_height_2)
# Screw Comparisons
inner_thread_r_5 = RemoteReceiver(inner_thread_r_2)
num_threads_2 = RemoteReceiver(num_threads)
thread_height_6 = RemoteReceiver(thread_height_2)
inner_thread_r_6 = RemoteReceiver(inner_thread_r_2)
num_threads_3 = RemoteReceiver(num_threads)

# ----
# Threads - Shared
multiplication = Multiplication(A=num_threads_2, B=2)
multiplication_2 = Multiplication(A=multiplication, B="6")
pi = Pi(Factor=multiplication)
base_point_1_4 = RemoteReceiver(base_point_1_2)
range = Range(Domain=pi, Steps=multiplication_2)
# Base - Shared
range_2 = Range(Domain=thread_height_5, Steps=multiplication_2)
pt_3 = PointCylindrical(BasePlane=base_point_1_4, Angle=range, Radius=inner_thread_r_5, Elevation=range_2)
num = Number(range)

# ----
# Threads - Shared
multiplication_3 = Multiplication(A=num_threads_3, B=2)
pi_2 = Pi(Factor=multiplication_3)
multiplication_4 = Multiplication(A=multiplication_3, B="6")
base_point_2_4 = RemoteReceiver(base_point_2_2)
range_3 = Range(Domain=thread_height_6, Steps=multiplication_4)
range_4 = Range(Domain=pi_2, Steps=multiplication_4)
pt_4 = PointCylindrical(BasePlane=base_point_2_4, Angle=range_4, Radius=inner_thread_r_6, Elevation=range_3)

radial_angles = Number(num)
radial_points = Point(pt_3)

thread_half_height = Slider(0.0146, range=0.005..0.05)
scale_out = Slider(1.08, range=1..1.2)

thread_half_height_2 = Slider(0.014, range=0.005..0.05)
phillips_length = Slider(0.32, range=0..1)
phillips_width = Slider(0.04, range=0..0.1)
phillips_depth = Slider(0.125, range=0..1)

thread_sides = Slider(4, range=3..6)

pdecon = Deconstruct(Point=radial_points)  # -> XComponent, YComponent, ZComponent
item = ListItem(List=radial_points, Index=0, Wrap=True)
intcrv = Interpolate(Vertices=radial_points, Degree=3, Periodic=False, KnotStyle=1)  # -> Curve, Length, Domain
base_point_1_5 = RemoteReceiver(base_point_1_2)
xz = XZPlane(Origin=item)
# Threads - A
Z_5 = UnitZ(Factor=pdecon.ZComponent)
rotate = Rotate(Geometry=xz, Angle=radial_angles, Plane=base_point_1_5)  # -> Geometry, Transform
move_5 = Move(Geometry=rotate.Geometry, Motion=Z_5)  # -> Geometry, Transform
polygon = Polygon(Plane=move_5.Geometry, Radius=thread_half_height_2, Segments=thread_sides, FilletRadius=0)  # -> Polygon, Length
swp1 = Sweep1(Rail=intcrv.Curve, Sections=polygon.Polygon, Miter=1)

top_of_screw_center = Point(pt_2)
Z_6 = UnitZ(Factor=Slider(0.125, range=0..1))
# Head - B
polygon_2 = Polygon(Plane=top_of_screw_center, Radius=Slider(0.219, range=0..1), Segments=6, FilletRadius=0)  # -> Polygon, Length
neg = Negative(Value=Z_6)
move_6 = Move(Geometry=polygon_2.Polygon, Motion=neg)  # -> Geometry, Transform
extr = Extrude(Base=polygon_2.Polygon, Direction=neg)
srf_3 = Surface([polygon_2.Polygon, move_6.Geometry])
join_3 = BrepJoin(Breps=[extr, srf_3])  # -> Breps, Closed

radial_points_2 = Point(pt_4)
# Threads - B
intcrv_2 = Interpolate(Vertices=radial_points_2, Degree=3, Periodic=False, KnotStyle=1)  # -> Curve, Length, Domain
Z_7 = UnitZ(Factor=thread_half_height)
base_point_2_5 = RemoteReceiver(base_point_2_2)
neg_2 = Negative(Value=Z_7)
move_7 = Move(Geometry=intcrv_2.Curve, Motion=Z_7)  # -> Geometry, Transform
scale_nu = ScaleNU(Geometry=intcrv_2.Curve, Plane=base_point_2_5, ScaleX=scale_out, ScaleY=scale_out, ScaleZ=1)  # -> Geometry, Transform
move_8 = Move(Geometry=intcrv_2.Curve, Motion=neg_2)  # -> Geometry, Transform
loft_3 = Loft(
    Curves=[move_7.Geometry, scale_nu.Geometry, move_8.Geometry],
    Options={Adjust=False, Closed=False, LoftEnds=0, LoftSimp=0, LoftType=3, Rebuild=10, Refit=0.01})

top_of_screw_center_2 = Point(pt)
# Head - A
box = CenterBox(Base=top_of_screw_center_2, X=phillips_length, Y=phillips_width, Z=phillips_depth)
box_2 = CenterBox(Base=top_of_screw_center_2, X=phillips_width, Y=phillips_length, Z=phillips_depth)
merge = Merge(Data1=box, Data2=box_2)

model_a_phillips = SolidDifference(BrepsA=join.Breps, BrepsB=merge)
model_b_hex = SolidDifference(BrepsA=join_2.Breps, BrepsB=join_3.Breps)
