# Grasshopper definition stairs.gh (Grasshopper 0.9.76)

# ---- group: Overall
total_height = Slider(10, range=0..30)
number = Slider(10, range=0..10)

# ----
total_depth = Slider(10, range=0..30)

# ---- group: Per-stair
width = Slider(4, range=0..10)
height = Slider(0.25, range=0..1)
depth = Slider(1, range=0..2)

# ---- group: Overall
step_height = Slider(1, range=0..2)
num_of_stairs = Slider(10, range=0..100)

# ---- group: per-stair
height_2 = Slider(0.25, range=0..1)
width_2 = Slider(4, range=0..10)
depth_2 = Slider(1, range=0..3)

# ----
vec = VectorXYZ(XComponent=total_depth, YComponent=0, ZComponent=total_height)  # -> Vector, Length
pt = ConstructPoint(XCoordinate=0, YCoordinate=0, ZCoordinate=0)
pt_2 = ConstructPoint(XCoordinate=0, YCoordinate=0, ZCoordinate=0)
vec_2 = VectorXYZ(XComponent=depth_2, YComponent=width_2, ZComponent=height_2)  # -> Vector, Length
move = Move(Geometry=pt, Motion=vec.Vector)  # -> Geometry, Transform
series = Series(Start=0, Step=step_height, Count=num_of_stairs)
box = Box2Pt(PointA=pt_2, PointB=vec_2.Vector, Plane=PlaneXY(0, 0, 0))
series_2 = Series(Start=0, Step=depth_2, Count=num_of_stairs)
vec_3 = VectorXYZ(XComponent=depth, YComponent=width, ZComponent=height)  # -> Vector, Length
range = Range(Domain=Domain(0, 1), Steps=number)
ln = Line(StartPoint=pt, EndPoint=move.Geometry)
vec_4 = VectorXYZ(XComponent=series_2, YComponent=0, ZComponent=series)  # -> Vector, Length
eval = EvaluateCurve(Curve=ln, Parameter=range)  # -> Point, Tangent, Angle
move_2 = Move(Geometry=eval.Point, Motion=vec_3.Vector)  # -> Geometry, Transform
output = Move(Geometry=box, Motion=vec_4.Vector)  # -> Geometry, Transform
output_2 = Box2Pt(PointA=eval.Point, PointB=move_2.Geometry, Plane=PlaneXY(0, 0, 0))
