# Grasshopper definition gears.ghx (Grasshopper 0.9.76)
# plug-ins: Pufferfish

pt = Point(<point referenced from the Rhino model>)
pt_2 = Point(<point referenced from the Rhino model>)
# # of teeth per millimeter of pitch diameter.
# 
# so P = NT / PD,
# and PD = NT / P.
extra_rotation = Slider(16.38, range=0..400)
tooth_height = Slider(0.74, range=0..1)
pressure_angle = Slider(20, range=10..30)
origins = Merge(Data1=pt_2, Data2=pt)
ln = Line(StartPoint=pt_2, EndPoint=pt)
standard_pitches = Panel("""0.1
0.2
0.3
0.4
0.5
0.6
0.8
1.0
1.25
1.5
2.0
2.5
3
4
5
6
8
10
12
16
20
25
32
40
50""")
series = Series(Start=Slider(6, range=0..10), Step=1, Count=Slider(100, range=0..100))
error_weight = Slider(0.991, range=0..1)

pt_3 = Point(<point referenced from the Rhino model>)
crv_cp = CurveClosestPoint(Point=pt_3, Curve=reparameterize(ln))  # -> Point, Parameter, Distance

dist = Distance(PointA=pt_2, PointB=pt)
subtraction = Subtraction(A=dist, B=tooth_height)
match = CSharpScript(target=subtraction, n_teeth=series, pitches=standard_pitches, factor=crv_cp.Parameter, e_weight=error_weight)  # -> out, Pitch, Teeth, Error; inputs n_teeth: list of Double, pitches: list of Double, factor: Double, e_weight: Double
# ---------- match: C# ----------
    var t = (double) target;

    double bestPitch = 0;
    var bestTeeth = new double[]{0,0};
    var bestdist = double.MaxValue;
    double bestdd = 0;

    foreach (var pitch in pitches) {
      for (var i = 0; i < n_teeth.Count; i++){
        var ri = (n_teeth[i] / pitch) / 2;
        for (var j = 0; j < n_teeth.Count; j++) {
          var rj = (n_teeth[j] / pitch) / 2;
          var dd = ri + rj - t;
          if (dd > 0) continue;

          var df = Math.Abs((ri / (ri + rj)) - factor) * t;
          var dist = (df * (1 - e_weight)) + (-dd * e_weight);

          if (dist < bestdist) {
            bestPitch = pitch;
            bestdist = dist;
            bestdd = dd;
            bestTeeth[0] = n_teeth[i];
            bestTeeth[1] = n_teeth[j];
          }
        }
      }
    }

    Pitch = bestPitch;
    Teeth = bestTeeth;
    Error = bestdd;
# ---------- end match ----------
of_teeth = Number(match.Teeth)
pitch = Number(match.Pitch)
division = Division(A=of_teeth, B=pitch)
pitch_diameter = Number(division)
origins_2 = Point(origins)
teeth = Teeth(F=tooth_height, center_point=origins_2, A=pitch_diameter, B=of_teeth, D=pressure_angle)
pi = Pi(Factor=2)
end = EndPoints(Curve=teeth)  # -> Start, End
division_2 = Division(A=pi, B=of_teeth)
ln_2 = Line(StartPoint=end.Start, EndPoint=end.End)
division_3 = Division(A=pitch_diameter, B=2)
join = JoinCurves(Curves=[ln_2, teeth], Preserve=False)

# ---- group: derive rotation angles to preserve meshing
cir = Circle(Plane=origins_2, Radius=division_3)
ccx = CurveCurve(CurveA=ln, CurveB=reparameterize(cir))  # -> Points, ParamsA, ParamsB
pi_2 = Pi(Factor=2)
division_4 = Division(A=division_2, B=2)
multiplication = Multiplication(A=pi_2, B=ccx.ParamsB)  # -> flatten(Result)
addition = Addition(A=multiplication, B=division_4)
item = ListItem(List=multiplication, Index=0, Wrap=True)  # -> Item, Item1
item_2 = ListItem(List=addition, Index=0, Wrap=True)  # -> Item, Item1
merge = Merge(Data1=item.Item, Data2=item_2.Item1)  # -> flatten(Result)

# ----
Z = UnitZ(Factor=Slider(1, range=0..1))
series_2 = Series(Start=0, Step=division_2, Count=of_teeth)
extr = Extrude(Base=join, Direction=Z)

# ---- group: extra rotation anim
pi_3 = Pi(Factor=2)
division_5 = Division(A=extra_rotation, B=division_3)
division_6 = Division(A=division_5, B=pi_3)
item_3 = ListItem(List=division_6, Index=0, Wrap=True)  # -> Item, Item1
neg = Negative(Value=item_3.Item1)
merge_2 = Merge(Data1=item_3.Item, Data2=neg)

# ----
smesh = SimpleMesh(Brep=extr)
mesh = MeshBrep(
    Brep=extr,
    Settings={GridMaxCount=0, GridMinCount=16, JaggedSeams=False, MaxEdgeLength=0, MinEdgeLength=0.0001, MinTolerance=0, Refine=True, RefineAngle=0, RelativeTolerance=0.65, SimplePlanes=True, Tolerance=0})
clsmsh = CloseMesh(Mesh=mesh, Quadrangulate=True)  # -> Closed, R
rotate = Rotate(Geometry=clsmsh.Closed, Angle=series_2, Plane=graft(origins_2))  # -> Geometry, Transform
polygon = Polygon(Plane=origins_2, Radius=3, Segments=6, FilletRadius=0)  # -> Polygon, Length
addition_2 = Addition(A=merge, B=merge_2)
rotate_2 = Rotate(Geometry=rotate.Geometry, Angle=graft(addition_2), Plane=graft(origins_2))  # -> Geometry, Transform
rotate_3 = Rotate(Geometry=graft(polygon.Polygon), Angle=graft(addition_2), Plane=graft(origins_2))  # -> Geometry, Transform
graft = GraftTree(Tree=cir, IncludeEmptyLists=True, IncludeNullItems=True)  # -> simplify(Tree)
graft_2 = GraftTree(Tree=rotate_3.Geometry, IncludeEmptyLists=True, IncludeNullItems=True)  # -> simplify(Tree)
boundary = BoundarySurfaces(Edges=[graft, graft_2])
extr_2 = Extrude(Base=boundary, Direction=Z)

# ==== cluster Teeth
A = ClusterInput()
center_point = ClusterInput()
pi = Pi(Factor=2)
B = ClusterInput()
division = Division(A=A, B=2)
pi_2 = Pi(Factor=1)
division_2 = Division(A=pi, B=B)
center_point_2 = Point(center_point)
panel = Panel("4")
X = UnitX(Factor=division)
division_3 = Division(A=division_2, B=Slider(3.43, range=3.2..4))
F = ClusterInput()
neg = Negative(Value=division_3)
move = Move(Geometry=center_point_2, Motion=X)  # -> Geometry, Transform
X_2 = UnitX(Factor=F)
addition = Addition(B=division_3)
D = ClusterInput()
addition_2 = Addition(B=neg)
multiplication = Multiplication(A=division_3, B=division)
rad = Radians(Degrees=D)
rotate = Rotate(Geometry=move.Geometry, Angle=addition, Plane=center_point_2)  # -> Geometry, Transform
rotate_2 = Rotate(Geometry=move.Geometry, Angle=addition_2, Plane=center_point_2)  # -> Geometry, Transform
panel_2 = Panel("10000")
move_2 = Move(Geometry=move.Geometry, Motion=X_2)  # -> Geometry, Transform
division_4 = Division(A=multiplication, B=Slider(2, range=0..10))
vec2pt = Vector2Pt(PointA=center_point_2, PointB=rotate_2.Geometry, Unitize=invert(False))  # -> Vector, Length
vec2pt_2 = Vector2Pt(PointA=center_point_2, PointB=rotate.Geometry, Unitize=invert(False))  # -> Vector, Length
neg_2 = Negative(Value=rad)
Y = UnitY(Factor=division_4)
neg_3 = Negative(Value=Y)
multiplication_2 = Multiplication(A=vec2pt_2.Vector, B=0.01)
multiplication_3 = Multiplication(A=vec2pt.Vector, B=0.01)
move_3 = Move(Geometry=move_2.Geometry, Motion=Y)  # -> Geometry, Transform
move_4 = Move(Geometry=move_2.Geometry, Motion=neg_3)  # -> Geometry, Transform
move_5 = Move(Geometry=rotate.Geometry, Motion=multiplication_2)  # -> Geometry, Transform
move_6 = Move(Geometry=rotate_2.Geometry, Motion=multiplication_3)  # -> Geometry, Transform
ln = Line(StartPoint=move_3.Geometry, EndPoint=move_4.Geometry)
rotate_3 = Rotate(Geometry=move_5.Geometry, Angle=neg_2, Plane=rotate.Geometry)  # -> Geometry, Transform
rotate_4 = Rotate(Geometry=move_6.Geometry, Angle=rad, Plane=rotate_2.Geometry)  # -> Geometry, Transform
end = EndPoints(Curve=ln)  # -> Start, End
vec2pt_3 = Vector2Pt(PointA=rotate_2.Geometry, PointB=rotate_4.Geometry, Unitize=False)  # -> Vector, Length
vec2pt_4 = Vector2Pt(PointA=rotate.Geometry, PointB=rotate_3.Geometry, Unitize=False)  # -> Vector, Length
arc = ArcSED(Start=rotate_2.Geometry, End=end.End, Direction=vec2pt_3.Vector)  # -> Arc, Plane, Radius
arc_2 = ArcSED(Start=rotate.Geometry, End=end.Start, Direction=vec2pt_4.Vector)  # -> Arc, Plane, Radius
entwine = Entwine(Branch00=arc_2.Arc, Branch01=ln, Branch02=arc.Arc, FlattenInputs=True)
flip = FlipMatrix(Data=entwine)
join = JoinCurves(Curves=flip, Preserve=False)
C = ClusterOutput(join)
